# Grasshopper definition 01 origami structures.gh (Grasshopper 1.0.7)

range = Range(Domain=Domain(0, 1), Steps=Slider(6, range=0..10))
pi = Pi(Factor=1)
graph = GraphMapper(
    range,
    x0=0,
    x1=1,
    y0=0,
    y1=1,
    container_name="Bezier",
    cpx=[0, 0.3239946663, 0.5267133117, 1],
    cpy=[0.1972619891, 0.5702317953, 0.5552271605, 0.490922153])
division = Division(A=pi, B=Slider(2, range=0..10))
ma = MassAddition(Input=graph)  # -> Result, PartialResults
multiplication = Multiplication(A=division, B=Slider(1, range=0.01..1))
division_2 = Division(A=ma.PartialResults, B=ma.Result)
multiplication_2 = Multiplication(A=division_2, B=multiplication)
sin = Sine(Value=multiplication_2)
cos = Cosine(Value=multiplication_2)
ma_2 = MassAddition(Input=cos)  # -> Result, PartialResults
ma_3 = MassAddition(Input=sin)  # -> Result, PartialResults
neg = Negative(Value=ma_3.PartialResults)
number_slider = Slider(6, range=0..10)
pt = ConstructPoint(XCoordinate=ma_2.PartialResults, YCoordinate=0, ZCoordinate=neg)
arrpolar = PolarArray(Geometry=pt, Plane=PlaneXY(0, 0, 0), Count=number_slider, Angle=6.283185307)  # -> Geometry, Transform
pt_2 = ConstructPoint(XCoordinate=0, YCoordinate=0, ZCoordinate=0)
flip = FlipMatrix(Data=arrpolar.Geometry)
item = ListItem(List=flip, Index=0, Wrap=True)  # -> flatten(Item), flatten(Item1), flatten(Item2), flatten(Item3), flatten(Item4)
xz = XZPlane(Origin=pt_2)
shift = ShiftList(List=item.Item, Shift=1, Wrap=True)
arrpolar_2 = PolarArray(Geometry=xz, Plane=PlaneXY(0, 0, 0), Count=number_slider, Angle=6.283185307)  # -> Geometry, Transform
cluster = Cluster(A=pt_2, B=item.Item, D=shift)  # -> C, B_3
cluster_2 = Cluster(A=pt_2, B=graft(item.Item), D=shift)  # -> C, B_3
cluster_3 = Cluster(A=item.Item, B=item.Item1, D=cluster.C)  # -> C, B_3
mirror = Mirror(Geometry=cluster_3.C, Plane=arrpolar_2.Geometry)  # -> Geometry, Transform
mirror_2 = Mirror(Geometry=cluster_3.B_3, Plane=arrpolar_2.Geometry)  # -> Geometry, Transform
shift_2 = ShiftList(List=mirror.Geometry, Shift=1, Wrap=True)
cluster_4 = Cluster(A=item.Item1, B=item.Item2, D=cluster_3.C)  # -> C, B_3
cluster_5 = Cluster(A=cluster.C, B=cluster_3.C, D=shift_2)  # -> C, B_3
mirror_3 = Mirror(Geometry=cluster_4.B_3, Plane=arrpolar_2.Geometry)  # -> Geometry, Transform
cluster_6 = Cluster(A=item.Item2, B=item.Item3, D=cluster_4.C)  # -> C, B_3
cluster_7 = Cluster(A=cluster_3.C, B=cluster_4.C, D=cluster_5.C)  # -> C, B_3
mirror_4 = Mirror(Geometry=cluster_7.C, Plane=arrpolar_2.Geometry)  # -> Geometry, Transform
mirror_5 = Mirror(Geometry=[cluster_7.B_3, cluster_6.B_3], Plane=arrpolar_2.Geometry)  # -> Geometry, Transform
shift_3 = ShiftList(List=mirror_4.Geometry, Shift=1, Wrap=True)
cluster_8 = Cluster(A=cluster_4.C, B=cluster_6.C, D=cluster_7.C)  # -> C, B_3
cluster_9 = Cluster(A=item.Item3, B=item.Item4, D=cluster_6.C)  # -> C, B_3
cluster_10 = Cluster(A=cluster_5.C, B=cluster_7.C, D=shift_3)  # -> C, B_3
mirror_6 = Mirror(Geometry=[cluster_9.B_3, cluster_8.B_3], Plane=arrpolar_2.Geometry)  # -> Geometry, Transform
preview = CustomPreview(
    Geometry=mirror_6.Geometry,
    Material={diffuse=RGB(221, 160, 221), emission=RGB(66, 48, 66), shine=0.5, specular=RGB(255, 255, 255), transparency=0})

# ==== cluster Cluster
A = ClusterInput()
B = ClusterInput()
D = ClusterInput()
D_2 = Point(D)
A_2 = Point(A)
B_2 = Point(B)
pi = Pi(Factor=1)
division = Division(A=pi, B=Slider(6, range=0..10))
vec2pt = Vector2Pt(PointA=A_2, PointB=B_2, Unitize=invert(False))  # -> Vector, Length
ln = Line(StartPoint=B_2, EndPoint=D_2)
sin = Sine(Value=division)
cos = Cosine(Value=division)
len = Length(Curve=ln)
midpt = CurveMiddle(Curve=ln)
pl = PlaneNormal(Origin=midpt, ZAxis=ln)
division_2 = Division(A=len, B=2)
multiplication = Multiplication(A=cos, B=vec2pt.Length)
multiplication_2 = Multiplication(A=sin, B=vec2pt.Length)
sqr = Square(Value=multiplication_2)
sqr_2 = Square(Value=division_2)
align = AlignPlane(Plane=pl, Direction=vec2pt.Vector)  # -> Plane, Angle
subtraction = Subtraction(A=sqr, B=sqr_2)
pl_origin = PlaneOrigin(Base=align.Plane, Origin=A_2)
sqrt = SquareRoot(Value=subtraction)
cir = Circle(Plane=align.Plane, Radius=sqrt)
cir_2 = Circle(Plane=pl_origin, Radius=multiplication)
ccx = CurveCurve(CurveA=cir, CurveB=cir_2)  # -> Points, ParamsA, ParamsB
item = ListItem(List=ccx.Points, Index=0, Wrap=True)  # -> flatten(Item)
subtraction_2 = Subtraction(A=item, B=A_2)
addition = Addition(A=subtraction_2, B=item)
srf4pt = _4PointSurface(CornerA=A_2, CornerB=D_2, CornerC=addition)
srf4pt_2 = _4PointSurface(CornerA=A_2, CornerB=B_2, CornerC=addition)
weave = Weave(Pattern=[0, 1], Stream0=srf4pt_2, Stream1=srf4pt, NullGaps=False)
join = BrepJoin(Breps=weave)  # -> Breps, Closed
B_3 = ClusterOutput(join.Breps)
C = ClusterOutput(addition)
